vi "Lab2RxTemplate.gvi"   [LabVIEW Communications System Design Suite 2.0.1]
panel controls:
  "IQ rate": f64 = 1000000
  "carrier frequency": f64 = 915000000
  "gain (dB)": f64
  "active antenna": string = "RX2"
  "number of samples": i64 = 200000
  "stop": bool
  "niUSRP Device": "niUSRPClass"
panel indicators:
  "actual IQ rate": f64
  "actual carrier frequency": f64
  "actual gain (dB)": f64
  "error out": error
  "Baseband Output": c128[]
  "Power Spectrum": T1
types:
  T1 = cluster{"f0": f64, "df": f64, "magnitude": f64[]}
diagram:
  call "niUSRP Open Rx Session.gvi"(niUSRP Device=$"niUSRP Device") -> (error out=w1, session handle out=w2)
  call "niUSRP Configure Signal.gvi"(session handle=w2, IQ rate=$"IQ rate", carrier frequency=$"carrier frequency", gain=$"gain (dB)", error in (no error)=w1, active antenna=$"active antenna") -> (session handle out=w3, coerced IQ rate=w4, coerced carrier frequency=w5, coerced gain=w6, Error Out=w7)
  call "LO Adjust.gvi"(niusrp in=w3, Actual IQ Rate=w4, Actual Carrier Freq=w5, error in=w7) -> (niusrp out=w8, error out=w9)
  call "niUSRP Initiate.gvi"(session handle=w8, error in (no error)=w9) -> (session handle out=w10, Error Out=w11)
  w12 = $"number of samples"
  while (after w4) {
    call "niUSRP Fetch Rx Data (CDB WDT).gvi"(session handle=w10, number of samples=w12, error in (no error)=w11) -> (session handle out=w13, Error Out=w14)
    Logical Or(w14, $stop) -> w15
    stop if w15
  }
  call "niUSRP Abort.gvi"(Handle in=w13, error in (no error)=w14) -> (Handle out=w16, Error Out=w17)
  call "niUSRP Close Session.gvi"(handle in=w16, error in=w17) -> (error out=w18)
  call "Simple Error Handler.gvi"(error in=w18) -> (error out=w19)
  $"error out" <- w19
  $"actual IQ rate" <- w4
  $"actual carrier frequency" <- w5
  $"actual gain (dB)" <- w6
