vi "Transmitter_TX.gvi"   [LabVIEW Communications System Design Software 2.0.1]
panel controls:
  "IQ rate": f64 = 200000
  "carrier frequency": f64 = 915100000
  "gain (dB)": f64
  "active antenna": string = "TX1"
  "message length (samples)": f64 = 200000
  "start frequency": f64 = 1000
  "delta frequency": f64 = 1000
  "Number of tones": i32 = 3
  "Modulation index": f64 = 1
  "Stop Button": bool
  "Device names": "niUSRPClass"
panel indicators:
  "actual IQ rate": f64
  "actual carrier frequency": f64
  "actual gain (dB)": f64
  "Error Out": error
  "Message": waveform<f64>
  "Baseband Signal": f64[]
diagram:
  call "niUSRP Open Tx Session.gvi"(Device names=$"Device names") -> (session handle out=w1, Error Out=w2)
  call "niUSRP Configure Signal.gvi"(session handle=w1, IQ rate=$"IQ rate", carrier frequency=$"carrier frequency", gain=$"gain (dB)", error in (no error)=w2, active antenna=$"active antenna") -> (session handle out=w3, coerced IQ rate=w4, coerced carrier frequency=w5, coerced gain=w6, Error Out=w7)
  Property Node(instance in=cluster{"Fs": f64, "#s": f64} {"Fs"=1000, "#s"=1000}, "#s"=$"message length (samples)", "Fs"=w4) -> (instance out=w8)
  w9 = 1  # Amplitude
  w10 = FALSE  # coerce frequencies
  call "Basic Multitone.gvi"(start frequency=$"start frequency", delta frequency=$"delta frequency", #tones=$"Number of tones", amplitude=w9, sampling info=w8, coerce frequencies?=w10) -> (signal out=w11)
  $Message <- w11
  Property Node(instance in=w11) -> ("Y"=w12)
  call "Quick Scale 1D.gvi"(X=w12) -> (max|X|=w13)
  Math Node("mp"=w13, "m"=w12, "mu"=$"Modulation index") -> ("A"=w14, "G"=w15)  # MathScript Node
  ~~~
  b = [ 1 + mu*(m/mp)];
  bp = max(abs(b))
  A = b/bp
  G = A*exp(j*0)
  ~~~
  $"Baseband Signal" <- w14
  while {
    call "niUSRP Write Tx Data (CDB).gvi"(session handle=w3, data=w15, end of data?=$"Stop Button", error in (no error)=w7) -> (session handle out=w16, Error Out=w17)
    Logical Or(w17, $"Stop Button") -> w18
    stop if w18
  }
  call "niUSRP Close Session.gvi"(handle in=w16, error in=w17) -> (error out=w19)
  call "Simple Error Handler.gvi"(error in=w19) -> (error out=w20)
  $"Error Out" <- w20
  $"actual IQ rate" <- w4
  $"actual carrier frequency" <- w5
  $"actual gain (dB)" <- w6
